# Grasshopper definition th-2200902-final-fullbricks -GT.gh (Grasshopper 1.0.7)
# plug-ins: TT Toolbox, Human, LunchBox, treesloth01

# ---- group: ORNAMENT+CRIME ll - DATASET GENERATION + GT
b_height = Slider(6, range=0..20)
b_width = Slider(12, range=0..20)
b_length = Slider(25, range=0..25)

# basebrick
domain_box = DomainBox(Base=PlaneXY(0, 0, 0), X=b_length, Y=b_width, Z=b_height)
deconstruct_brep = DeconstructBrep(Brep=domain_box)  # -> Faces, Edges, Vertices
list_item = ListItem(List=deconstruct_brep.Faces, Index=Slider(4, range=0..10), Wrap=True)
area = Area(Geometry=list_item)  # -> Area, Centroid
xy_plane = XYPlane(Origin=area.Centroid)

panel = Panel("https://energyplus-weather.s3.amazonaws.com/europe_wmo_region_6/AUT/AUT_Vienna.Schwechat.110360_IWEC/AUT_Vienna.Schwechat.110360_IWEC.zip")
epw_stat = Ladybug_OpenEPWAndSTATWeatherFiles(weatherFileURL=panel)  # -> epwFile, statFile; plug-in component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

gencumulativeskymtx = Ladybug_GenCumulativeSkyMtx(epwFile=epw_stat.epwFile, skyDensity=0, useOldRes=True, runIt=Toggle(True))  # -> readMe, cumulativeSkyMtx; plug-in component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
analysisperiod = Ladybug_AnalysisPeriod(
    fromMonth=Slider(8, range=0..10),
    fromDay=Slider(8, range=0..100),
    fromHour=Slider(12, range=0..24),
    toMonth=Slider(8, range=0..12),
    toDay=Slider(8, range=0..100),
    toHour=Slider(18, range=0..100))  # -> readMe, analysisPeriod; plug-in component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
selectskymtx = Ladybug_selectSkyMtx(
    cumulativeSkyMtx=gencumulativeskymtx.cumulativeSkyMtx,
    analysisPeriod=analysisperiod.analysisPeriod,
    removeDiffuse=False,
    removeDirect=False)  # -> readMe, selectedSkyMtx; plug-in component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

# ---- group: ORNAMENT+CRIME ll - DATASET GENERATION + GT / 8-vienna-1020-bruno-marek-alle - flat
geometry = Geometry(<brep referenced from the Rhino model>)

# ---- group: ORNAMENT+CRIME ll - DATASET GENERATION + GT
_9_vienna_1200_engerthstraße_flat = Geometry(<brep referenced from the Rhino model>)

# ---- group: ORNAMENT+CRIME ll - DATASET GENERATION + GT / 10-vienna-1200-dresdnerstrasse - flat
geometry_2 = Geometry(<brep referenced from the Rhino model>)

# ---- group: ORNAMENT+CRIME ll - DATASET GENERATION + GT / 11-RR-laboratoryV1-flat
geometry_3 = Geometry(<brep referenced from the Rhino model>)

# ---- group: ORNAMENT+CRIME ll - DATASET GENERATION + GT / 12-RR-laboratoryV2-flat
geometry_4 = Geometry(<brep referenced from the Rhino model>)

# ---- group: ORNAMENT+CRIME ll - DATASET GENERATION + GT / 13-RR-laboratoryV3-flat
geometry_5 = Geometry(<brep referenced from the Rhino model>)

# ---- group: ORNAMENT+CRIME ll - DATASET GENERATION + GT / 15-RR-online2-flat
geometry_6 = Geometry(<brep referenced from the Rhino model>)

# ---- group: ORNAMENT+CRIME ll - DATASET GENERATION + GT
radiationanalysis = Ladybug_RadiationAnalysis(
    geometry=flatten(geometry_6),
    gridSize=Slider(10, range=0..100),
    disFromBase=Slider(0.1, range=0..1),
    selectedSkyMtx=flatten(selectskymtx.selectedSkyMtx),
    runIt=Toggle(True))  # -> readMe, contextMesh, analysisMesh, testPts, testVec, port, flatten(radiationResult), radiationMesh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; plug-in component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

# ---- group: ORNAMENT+CRIME ll - DATASET GENERATION + GT / 14-RR-online1-flat
geometry_7 = Geometry(<brep referenced from the Rhino model>)

# ---- group: OLD-SINGLE SRF
panel_2 = Panel("https://energyplus-weather.s3.amazonaws.com/europe_wmo_region_6/AUT/AUT_Vienna.Schwechat.110360_IWEC/AUT_Vienna.Schwechat.110360_IWEC.zip")  # disabled
epw_stat_2 = Ladybug_OpenEPWAndSTATWeatherFiles(weatherFileURL=panel_2)  # -> epwFile, statFile; disabled; plug-in component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

number_slider = Slider(6, range=0..10)  # disabled
number_slider_2 = Slider(6, range=0..12)  # disabled
number_slider_3 = Slider(12, range=0..24)  # disabled
number_slider_4 = Slider(21, range=0..100)  # disabled
number_slider_5 = Slider(21, range=0..100)  # disabled
number_slider_6 = Slider(18, range=0..100)  # disabled
toggle = BooleanToggle(True)  # disabled
gencumulativeskymtx_2 = Ladybug_GenCumulativeSkyMtx(epwFile=epw_stat_2.epwFile, skyDensity=0, useOldRes=True, runIt=toggle)  # -> readMe, cumulativeSkyMtx; disabled; plug-in component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
analysisperiod_2 = Ladybug_AnalysisPeriod(
    fromMonth=number_slider,
    fromDay=number_slider_4,
    fromHour=number_slider_3,
    toMonth=number_slider_2,
    toDay=number_slider_5,
    toHour=number_slider_6)  # -> readMe, analysisPeriod; disabled; plug-in component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
selectskymtx_2 = Ladybug_selectSkyMtx(
    cumulativeSkyMtx=gencumulativeskymtx_2.cumulativeSkyMtx,
    analysisPeriod=analysisperiod_2.analysisPeriod,
    removeDiffuse=False,
    removeDirect=False)  # -> readMe, selectedSkyMtx; disabled; plug-in component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

# ---- group: OLD-SINGLE SRF / Feature dimension (=3)
nr_of_bricks = Slider(16, range=0..200)  # disabled

# ---- group: OLD-SINGLE SRF / BRUNO MAREK ALLE - FLAT
geometry_8 = Geometry(<brep referenced from the Rhino model>)  # disabled

# ---- group: OLD-SINGLE SRF
number_slider_7 = Slider(1, range=0..1)  # disabled
number_slider_8 = Slider(10, range=0..100)  # disabled
toggle_2 = BooleanToggle(True)  # disabled
radiationanalysis_2 = Ladybug_RadiationAnalysis(
    geometry=flatten(geometry_8),
    gridSize=number_slider_8,
    disFromBase=number_slider_7,
    selectedSkyMtx=flatten(selectskymtx_2.selectedSkyMtx),
    runIt=toggle_2)  # -> readMe, contextMesh, analysisMesh, testPts, testVec, port, flatten(radiationResult), radiationMesh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; disabled; plug-in component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

# ---- group: OLD-SINGLE SRF / ENGHERTSTRASSE
geometry_9 = Geometry([<brep referenced from the Rhino model> x100])  # disabled

# ---- group: ORNAMENT+CRIME ll - DATASET GENERATION + GT / 666-1000
total_surfaces_areas = Data([24290.17815, 26602.91946, 27913.74076, 26218.80206, 26527.70337, 27337.56467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])
solar_irr_total = Data([0.9830226017, 0.9591973283, 0.9445608408, 0.9799237263, 0.9684397208, 0.9382587955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])
solar_irr_per_srf = Data([2027.436514, 1744.129676, 1444.038825, 1299.909257, 1603.422575, 1801.043314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])

# ---- group: ORNAMENT+CRIME ll - DATASET GENERATION + GT / 8-CORR-values-SFB-1-2500
solar_irr_per_srf_2 = Data([1197, 1392, 1472, 1170, 1134, 1256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])
solar_irr_total_2 = Data([28918, 27809, 27775, 27415, 27758, 27558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])

# ---- group: ORNAMENT+CRIME ll - DATASET GENERATION + GT / 666-1000x1000 - integer
total_surfaces_areas_2 = Data([26602.91946, 27913.74076, 26218.80206, 26527.70337, 27337.56467, 27145.50597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])

# ---- group: ORNAMENT+CRIME ll - DATASET GENERATION + GT
solar_irr_per_srf_3 = Data([1744.129676, 1444.038825, 1299.909257, 1603.422575, 1801.043314, 1344.907618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])
solar_irr_total_3 = Data([9830, 9592, 9446, 9799, 9684, 9383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])

# ---- group: ORNAMENT+CRIME ll - DATASET GENERATION + GT / 8-CORR-values-SFB-15-2500
solar_irr_per_srf_4 = Data([1005, 1422, 1891, 990, 4157, 990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])
solar_irr_total_4 = Data([26897, 26202, 28383, 27402, 25913, 25921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])

# ---- group: ORNAMENT+CRIME ll - DATASET GENERATION + GT / 666-1000-2-1000
total_surfaces_areas_3 = Data([23870.1553, 26042.89702, 27213.71874, 27382.62046, 26549.60218, 27720.4239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])
solar_irr_per_srf_5 = Data([2342.110876, 1560.903676, 1661.037369, 1489.156451, 1293.867046, 1636.943873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])
solar_irr_total_5 = Data([9865, 9774, 9486, 9540, 9839, 9403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])

# ---- group: ORNAMENT+CRIME ll - DATASET GENERATION + GT / 8-CORR-values-SFB-1-TEX-2050
solar_irr_per_srf_6 = Data([1197, 1392, 1472, 1170, 1134, 1256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])
solar_irr_total_6 = Data([289180000, 278090000, 277750000, 274150000, 277580000, 275580000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])

# ---- group: ORNAMENT+CRIME ll - DATASET GENERATION + GT / 666-5000-SFB
total_surfaces_areas_4 = Data([24988.43688, 24988.43688, 26562.61952, 27664.12216, 27056.70479, 26950.24743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])
solar_irr_per_srf_7 = Data([2083.177876, 2083.177876, 1891.720524, 1610.494917, 1212.616431, 1543.029877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])
solar_irr_total_7 = Data([9792, 9792, 9642, 9536, 9748, 9731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])

# ---- group: ORNAMENT+CRIME ll - DATASET GENERATION + GT / 7-C-1-2000
total_surfaces_areas_5 = Data([29842.39798, 27674.20301, 26445.30804, 28034.31307, 27744.71809, 26985.47312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])
solar_irr_per_srf_8 = Data([857.0911387, 919.6321429, 1204.132789, 854.4626414, 945.0380999, 986.3375367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])
solar_irr_total_8 = Data([17405, 16660, 16788, 17198, 17142, 16798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])

# ---- group: ORNAMENT+CRIME ll - DATASET GENERATION + GT / 7-C-SFB-1-2000
total_surfaces_areas_6 = Data([29898.82042, 28423.0242, 27390.36548, 27959.81926, 28059.62303, 27220.12681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])
solar_irr_per_srf_9 = Data([848.1308938, 899.9856517, 1212.082288, 802.043931, 954.0367005, 1040.559787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])
solar_irr_total_9 = Data([17709, 16701, 16541, 16960, 16877, 16525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])

# ---- group: ORNAMENT+CRIME ll - DATASET GENERATION + GT / 8-C-SFB-1-2000
total_surfaces_areas_7 = Data([69343, 69343, 69343, 69343, 69343, 69343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])
solar_irr_per_srf_10 = Data([24598, 23897, 23809, 23878, 24140, 24217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])
solar_irr_total_10 = Data([658, 652, 650, 660, 655, 650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])

# ---- group: ORNAMENT+CRIME ll - DATASET GENERATION + GT / 8-C-SFB-1-50
total_surfaces_areas_8 = Data([69343, 69343, 69343, 69343, 69343, 69343, 69343, 69343, 69343, 69343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])
solar_irr_per_srf_11 = Data([23825, 23834, 23798, 23657, 23940, 24835, 24104, 23488, 23951, 23479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])
solar_irr_total_11 = Data([648, 653, 649, 651, 660, 662, 663, 652, 661, 647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])

# ---- group: ORNAMENT+CRIME ll - DATASET GENERATION + GT / compile dataset
panel_3 = Panel("C:\mephistopheles\work\privat\MaCAD\modul3-aia\s1-data-encoding\lecture-6\data\")

# ---- group: ORNAMENT+CRIME ll - DATASET GENERATION + GT
number_slider_9 = Slider(104, range=0..500)
b_height_2 = Slider(6.8, range=0..20)
xz_plane = XZPlane(Origin=Point(0, 0, 0))
plane_surface = PlaneSurface(Plane=xz_plane, XSize=Slider(102, range=0..500), YSize=number_slider_9)
number_slider_10 = Slider(6, range=0..10)
number_slider_11 = Slider(25, range=0..100)
unit_z = UnitZ(Factor=1)
surface = Surface(plane_surface)
contour = Contour(Shape=surface, Point=xz_plane, Direction=unit_z, Distance=b_height_2)  # -> flatten(Contours)
curve = Curve(contour)
dispatch = Dispatch(List=curve, DispatchPattern=[True, False])  # -> ListA, ListB
division = Division(A=number_slider_9, B=b_length)
number_slider_12 = Slider(10, range=0..100)
curve_2 = Curve(dispatch.ListA)
curve_3 = Curve(dispatch.ListB)
horizontal_frames = HorizontalFrames(Curve=curve_2, Count=number_slider_12)  # -> Frames, Parameters
horizontal_frames_2 = HorizontalFrames(Curve=curve_3, Count=number_slider_12)  # -> Frames, Parameters
number_slider_13 = Slider(12, range=-10..12)
number_slider_14 = Slider(1, range=0..16)
ladybug = Ladybug_Ladybug(defaultFolder=Toggle(False))  # -> Vviiiiiiiiiizzz; plug-in component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
seed = Slider(0, range=0..2000)
seed_2 = Slider(500, range=0..500)
seed_3 = Slider(2049, range=0..2049)
panel_4 = Panel("4 to 12")
panel_5 = Panel(radiationanalysis.totalRadiation)
unit_y = UnitY(Factor=Slider(4, range=0..100))
unit_y_2 = UnitY(Factor=Slider(-12, range=-12..12))
mesh = Mesh(radiationanalysis.radiationMesh)
point = Point(radiationanalysis.testPts)
material_table = MaterialTable(Update=True)  # -> MaterialName, Shader, Diffuse, Specular, Emission, Alpha, Gloss
bar_graph = BarGraph(radiationanalysis.radiationResult, BarColor=RGB(255, 0, 90))
list_item_2 = ListItem(List=material_table.MaterialName, Index="0", Wrap=True)
multiplication = Multiplication(A=radiationanalysis.totalRadiation, B=Slider(10000, range=0..1000000))
panel_7 = Panel(multiplication)
mass_addition = MassAddition(Input=radiationanalysis.radiationResult)  # -> Result, PartialResults
integer = Integer(panel_7)
integer_2 = Integer(mass_addition.Result)
panel_8 = Panel(integer_2)
labels = Panel("""SOLAR_IRR_TOTAL
SOLAR_IRR_PER_SRF""")
write_options = WriteOptions(
    FilePath=panel_3,
    ClearDataOverwrite=True,
    SaveAfterWrite=Toggle(True),
    CloseAfterWrite=False,
    ColumnStartPosition=1,
    RowStartPosition=1)  # -> UserMessages, WriteOptions
boolean_toggle = BooleanToggle(False)

# shifted bricks
dispatch_2 = Dispatch(List=horizontal_frames.Frames, DispatchPattern=[True, False])  # -> ListA, ListB
dispatch_3 = Dispatch(List=horizontal_frames_2.Frames, DispatchPattern=[True, False])  # -> ListA, ListB
plane = Plane(dispatch_2.ListA)
plane_2 = Plane(dispatch_3.ListB)

# ---- group: ORNAMENT+CRIME ll - DATASET GENERATION + GT / NEW - TOP SRF ONLY
number_slider_15 = Slider(16, range=0..100)
number_slider_16 = Slider(4, range=0..100)
quad_panels = QuadPanels(Surface=plane_surface, UDivisions=number_slider_16, VDivisions=number_slider_15)  # -> graft(Panels)

# ---- group: OLD-SINGLE SRF / NEW - TOP SRF ONLY
number_slider_17 = Slider(16, range=0..100)  # disabled
number_slider_18 = Slider(4, range=0..100)  # disabled
quad_panels_2 = QuadPanels(Surface=plane_surface, UDivisions=number_slider_18, VDivisions=number_slider_17)  # -> graft(Panels); disabled

# ---- group: ORNAMENT+CRIME ll - DATASET GENERATION + GT (continued)
plane_3 = Plane(simplify([plane_2, plane]))
partition_list = PartitionList(List=plane_3, Size=Slider(2, range=0..10))
staggered_quad_panels = StaggeredQuadPanels(Surface=plane_surface, UDivisions=number_slider_16, VDivisions=number_slider_15)  # -> graft(Panels)

# ---- group: ORNAMENT+CRIME ll - DATASET GENERATION + GT / NEW - TOP SRF ONLY
unit_y_3 = UnitY(Factor=number_slider_13)  # -> graft(UnitVector)
multiplication_2 = Multiplication(A=unit_y_3, B=Slider(1.01, range=0..10))
curve_4 = Curve(staggered_quad_panels)
offset_on_srf = OffsetOnSrf(Curve=curve_4, Distance=Slider(0.25, range=0..1), Surface=staggered_quad_panels)
surface_2 = Surface(offset_on_srf)

# ---- group: ORNAMENT+CRIME ll - DATASET GENERATION + GT (continued)
surface_3 = Surface(offset_on_srf)
solid_difference = SolidDifference(BrepsA=surface_2, BrepsB=staggered_quad_panels)
move = Move(Geometry=solid_difference, Motion=unit_y)  # -> Geometry, Transform

unit_y_4 = UnitY(Factor=Slider(3, range=0..10))
extrude = Extrude(Base=move.Geometry, Direction=unit_y_4)

# ---- group: ORNAMENT+CRIME ll - DATASET GENERATION + GT / NEW - TOP SRF ONLY
extrude_2 = Extrude(Base=surface_3, Direction=multiplication_2)

# ---- group: ORNAMENT+CRIME ll - DATASET GENERATION + GT (continued)
flip_last = FlipLast(Data=extrude_2)
partition_list_2 = PartitionList(List=flatten(flip_last), Size=number_slider_14)
list_length = ListLength(List=flatten(partition_list_2))
division_2 = Division(A=list_length, B=number_slider_14)
integer_3 = Integer(division_2)
geometry_10 = Geometry(extrude_2)

# ---- group: OLD - WHOLE BRICK
# remapping - shifted bricks
wlc_01_movement = GenePool(Decimals=0, Maximum=4, Minimum=-4, Value=[0, 0, 0, 0, 0, 0, 0, 0, 0])  # disabled
orient = Orient(Geometry=domain_box, Source=xy_plane, Target=partition_list)  # -> Geometry, Transform; disabled

# ---- group: ORNAMENT+CRIME ll - DATASET GENERATION + GT
panel_9 = Panel(seed_3)
random = Random(Range=panel_4, Number=integer_3, Seed=panel_9)

# ---- group: ORNAMENT+CRIME ll - DATASET GENERATION + GT / Weaves data into tree
c_script = CSharpScript(x=random, y=integer_3)  # -> A; inputs x: list of Double, y: Int32
# ---------- c_script: C# ----------
    var tree = new DataTree<double>();
    GH_Path path;
    int legge = x.Count / y;
    int counter = 0;
    
    for (int i = 0; i < legge; i++)
    {
      path = new GH_Path(i);
      for (int j = 0; j < y; j++)
      {
        tree.Add(x[counter], path);
        counter++;
      }
    }

    A = tree;
# ---------- end c_script ----------

# ---- group: ORNAMENT+CRIME ll - DATASET GENERATION + GT (continued)
panel_10 = Panel(c_script)

unit_y_5 = UnitY(Factor=c_script)  # -> graft(UnitVector)
move_2 = Move(Geometry=partition_list_2, Motion=graft(unit_y_5))  # -> Geometry, Transform
move_3 = Move(Geometry=move_2.Geometry, Motion=unit_y_2)  # -> Geometry, Transform

# ---- group: ORNAMENT+CRIME ll - DATASET GENERATION + GT / NEW - TOP SRF ONLY (continued)
geometry_11 = Geometry([move_3.Geometry, move.Geometry])

# ---- group: ORNAMENT+CRIME ll - DATASET GENERATION + GT / NEW
solid_union = SolidUnion(Breps=flatten(geometry_11))

# ---- group: ORNAMENT+CRIME ll - DATASET GENERATION + GT / change orientation to south
wlc_02_rotation = Slider(180, range=0..360)
rotate = Rotate(Geometry=solid_union, Angle=degrees(wlc_02_rotation), Plane=PlaneXY(0, 0, 0))  # -> Geometry, Transform

# ---- group: ORNAMENT+CRIME ll - DATASET GENERATION + GT / GENERATED
geometry_12 = Geometry(rotate.Geometry)

# ---- group: OLD - WHOLE BRICK
# rotation
wlc_02_rotation_2 = Slider(0, range=0..360)  # disabled

# ---- group: ORNAMENT+CRIME ll - DATASET GENERATION + GT (continued)
custom_preview = CustomPreview(Geometry=rotate.Geometry, Material=list_item_2)  # disabled
area_2 = Area(Geometry=geometry_12)  # -> Area, Centroid
mass_addition_2 = MassAddition(Input=flatten(area_2.Area))  # -> Result, PartialResults
integer_4 = Integer(mass_addition_2.Result)

# DATASET SETUP
data_recorder = DataRecorder(wlc_02_rotation, DataLimit=-10, RecordData=False)
data_recorder_2 = DataRecorder(integer_2, DataLimit=-10, RecordData=True)
data_recorder_3 = DataRecorder(integer, DataLimit=-10, RecordData=True)
data_recorder_4 = DataRecorder(integer_4, DataLimit=-10, RecordData=False)

total_surfaces_areas_9 = Data(data_recorder_4)

solar_irr_per_srf_12 = Data(data_recorder_2)
solar_irr_total_12 = Data(data_recorder_3)

rotation = Data(data_recorder)

# ---- group: OLD-SINGLE SRF
number_slider_19 = Slider(8, range=-10..10)  # disabled
staggered_quad_panels_2 = StaggeredQuadPanels(Surface=plane_surface, UDivisions=number_slider_18, VDivisions=number_slider_17)  # -> graft(Panels); disabled
boolean_toggle_2 = BooleanToggle(False)  # disabled
number_slider_20 = Slider(1, range=0..10)  # disabled
ladybug_2 = Ladybug_Ladybug(defaultFolder=boolean_toggle_2)  # -> Vviiiiiiiiiizzz; disabled; plug-in component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
seed_4 = Slider(0, range=0..2000)  # disabled
seed_5 = Slider(0, range=0..5000)  # disabled
panel_11 = Panel("0.5 to 8")  # disabled
number_slider_21 = Slider(10000, range=0..1000000)  # disabled
panel_12 = Panel(radiationanalysis_2.totalRadiation)  # disabled
material_table_2 = MaterialTable(Update=True)  # -> MaterialName, Shader, Diffuse, Specular, Emission, Alpha, Gloss; disabled
multiplication_3 = Multiplication(A=radiationanalysis_2.totalRadiation, B=number_slider_21)  # disabled
panel_13 = Panel("0")  # disabled
list_item_3 = ListItem(List=material_table_2.MaterialName, Index=panel_13, Wrap=True)  # disabled
panel_14 = Panel(multiplication_3)  # disabled
integer_5 = Integer(panel_12)  # disabled

# ---- group: OLD-SINGLE SRF / NEW - TOP SRF ONLY
number_slider_22 = Slider(1.01, range=0..10)  # disabled
unit_y_6 = UnitY(Factor=number_slider_19)  # -> graft(UnitVector); disabled
multiplication_4 = Multiplication(A=unit_y_6, B=number_slider_22)  # disabled
number_slider_23 = Slider(0.25, range=0..1)  # disabled
curve_5 = Curve(staggered_quad_panels_2)  # disabled
offset_on_srf_2 = OffsetOnSrf(Curve=curve_5, Distance=number_slider_23, Surface=staggered_quad_panels_2)  # disabled
surface_4 = Surface(offset_on_srf_2)  # disabled

# ---- group: OLD-SINGLE SRF (continued)
surface_5 = Surface(offset_on_srf_2)  # disabled
flip_matrix = FlipMatrix(Data=surface_5)  # disabled
partition_list_3 = PartitionList(List=flip_matrix, Size=number_slider_20)  # disabled
list_length_2 = ListLength(List=flatten(partition_list_3))  # disabled
division_3 = Division(A=list_length_2, B=number_slider_20)  # disabled
integer_6 = Integer(division_3)  # disabled

# ---- group: OLD-SINGLE SRF / NEW - TOP SRF ONLY
extrude_3 = Extrude(Base=partition_list_3, Direction=multiplication_4)  # disabled
cap_holes = CapHoles(Brep=extrude_3)  # disabled
deconstruct_brep_2 = DeconstructBrep(Brep=cap_holes)  # -> Faces, Edges, Vertices; disabled
number_slider_24 = Slider(6, range=0..10)  # disabled
solid_difference_2 = SolidDifference(BrepsA=surface_4, BrepsB=staggered_quad_panels_2)  # disabled
cull_index = CullIndex(List=deconstruct_brep_2.Faces, Indices=number_slider_24, Wrap=True)  # disabled
geometry_13 = Geometry(cull_index)  # disabled
brep_join = BrepJoin(Breps=flatten([solid_difference_2, geometry_13]))  # -> Breps, Closed; disabled
geometry_14 = Geometry(brep_join.Breps)  # disabled

# ---- group: OLD-SINGLE SRF / change orientation to south
wlc_02_rotation_3 = Slider(180, range=0..360)  # disabled
rotate_2 = Rotate(Geometry=geometry_14, Angle=degrees(wlc_02_rotation_3), Plane=PlaneXY(0, 0, 0))  # -> Geometry, Transform; disabled

# ---- group: OLD-SINGLE SRF (continued)
custom_preview_2 = CustomPreview(Geometry=rotate_2.Geometry, Material=list_item_3)  # disabled

# ---- group: ORNAMENT+CRIME ll - DATASET GENERATION + GT (continued)
data_recorder_5 = DataRecorder(rotate_2.Geometry, DataLimit=-10, RecordData=False)
geometry_15 = Geometry(data_recorder_5)
entwine = Entwine(
    Branch00=rotation,
    Branch01=solar_irr_total_12,
    Branch02=solar_irr_per_srf_12,
    Branch03=total_surfaces_areas_9,
    FlattenInputs=True)

write_to_excel = WriteToExcel(
    Run=Toggle(False),
    ExcelWorksheet="1",
    ColumnNames=labels,
    WriteOptions=write_options.WriteOptions,
    ColumnnsOrRows=boolean_toggle,
    DataToWriteIntoColumns=entwine)

# ---- group: OLD-SINGLE SRF
number_slider_25 = Slider(1, range=0..10)  # disabled
multiplication_5 = Multiplication(A=number_slider_25, B=nr_of_bricks)  # disabled
panel_15 = Panel(seed_4)  # disabled
random_2 = Random(Range=panel_11, Number=integer_6, Seed=panel_15)  # disabled

# ---- group: OLD-SINGLE SRF / Weaves data into tree
c_script_2 = CSharpScript(x=random_2, y=integer_6)  # -> A; inputs x: list of Double, y: Int32; disabled; same code as c_script

# ---- group: OLD - WHOLE BRICK (continued)
unit_y_7 = UnitY(Factor=c_script_2)  # -> graft(UnitVector); disabled
move_4 = Move(Geometry=orient.Geometry, Motion=graft(unit_y_7))  # -> Geometry, Transform; disabled

rotate_3 = Rotate(Geometry=move_4.Geometry, Angle=degrees(wlc_02_rotation_2), Plane=PlaneXY(0, 0, 0))  # -> Geometry, Transform; disabled

# ---- group: OLD-SINGLE SRF (continued)
panel_16 = Panel(c_script_2)  # disabled

# ---- group: OLD - WHOLE BRICK
solid_union_2 = SolidUnion(Breps=flatten(rotate_3.Geometry))  # disabled
custom_preview_3 = CustomPreview(
    Geometry=move_4.Geometry,
    Material={diffuse=RGB(221, 160, 221), emission=RGB(66, 48, 66), shine=0.5, specular=RGB(255, 255, 255), transparency=0})  # disabled
material_table_3 = MaterialTable(Update=True)  # -> MaterialName, Shader, Diffuse, Specular, Emission, Alpha, Gloss; disabled

material_table_4 = MaterialTable(Update=True)  # -> MaterialName, Shader, Diffuse, Specular, Emission, Alpha, Gloss; disabled
panel_17 = Panel("0")  # disabled
list_item_4 = ListItem(List=material_table_4.MaterialName, Index=panel_17, Wrap=True)  # disabled
custom_preview_4 = CustomPreview(Geometry=rotate_3.Geometry, Material=list_item_4)  # disabled
